# Grasshopper definition build.gh (Grasshopper 1.0.7)
# plug-ins: Firefly.X

timer = Timer(TimerInterval=20, Target=[udp_listener, udp_sender])
udp_listener = UDPListener(Port="5005")
geo = Geometry(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)

len = TextLength(Text=udp_listener)
equals = Equality(FirstNumber=len, SecondNumber=0)  # -> Equality, Inequality
dispatch = Dispatch(List=udp_listener, DispatchPattern=equals.Inequality)  # -> ListA, ListB
rec = DataRecorder(dispatch.ListA, DataLimit=-10, RecordData=True)
panel = Panel(rec)

python = GhPythonScript(RUN=Toggle(True), init_geo=geo, udp_in=udp_listener)  # -> out, udp_out; inputs init_geo: Brep
# ---------- python: Python ----------
__author__ = "Ozguc Capunaman"
__version__ = "2019.03.13"

import rhinoscriptsyntax as rs
import time
import os

def initSlice(init_geo, resolution=50, layer_height=1):
    result = []
    plane = rs.PlaneFromPoints((-500,-500,0), (0,-500,0), (-500,0,0))
    planeSrf = rs.AddPlaneSurface(plane, 1000, 1000)
    crv = rs.IntersectBreps(init_geo, planeSrf)
    pts = rs.DivideCurve(crv, resolution)
    result.extend(pts)
    while True:
        vec = rs.CreateVector((0,0,1))
        planeSrf = rs.MoveObject(planeSrf, vec)
        crv = rs.IntersectBreps(init_geo, planeSrf)
        if crv == None:
            break
        pts = rs.DivideCurve(crv, resolution)
        result.extend(pts)
    return result

def pts2xyz(pts, FN, DIR = "C:\Users\Ozguc Capunaman\Documents\GitHub\InteractiveDigitalFabrication\xyz\\"):
    filepath = DIR+FN+".xyz"
    if(os.path.exists(filepath)):
        raise Exception('File already exists!')
    else:
        file = open(filepath, "w+")
        for i in range(len(pts)):
            coord = pts[i]
            file.write(str(coord[0]) + " " + str(coord[1]) + " " + str(coord[2]) + "\r\n")

def xyz2pts(FN, DIR = "C:\Users\Ozguc Capunaman\Documents\GitHub\InteractiveDigitalFabrication\xyz\\"):
    filepath = DIR+FN+".xyz"
    if(os.path.exists(filepath)):
        result = []
        with open(filepath) as fp:  
           line = fp.readline()
           while line:
               curLine = line.strip()
               coord = curLine.split(' ')
               for i in range(len(coord)):
                   coord[i] = float(coord[i])
               result.append(rs.AddPoint(coord))
               line = fp.readline()
        return result
    else:
        raise Exception('File doesn\'t exist!')

def decodeMessage(udp_in):
    return udp_in.split("_")

def run(RUN, udp_in):
    if RUN:
        if udp_in != b'':
            argsList = decodeMessage(udp_in)
            if argsList[0] == "+gh":
                # Handshake with py
                if argsList[1] == "handshake":
                    time.sleep(.1)
                    return "-gh_success"
                elif argsList[1] == "initGeo":
                    # (1)function_(2)resolution_(3)layerheight_(4)filename
                    if init_geo == None:
                        time.sleep(.1)
                        return "-gh_fail_noInitGeo"
                    else:
                        pts = initSlice(init_geo, int(argsList[2]), int(argsList[3]))
                        pts2xyz(pts, argsList[4])
                    time.sleep(.1)
                    return "-gh_success"
                elif argsList[1] == "func2":
                    time.sleep(.1)
                    return "-gh_done"
    return ""     

udp_out = run(RUN, udp_in)
# ---------- end python ----------

len_2 = TextLength(Text=python.udp_out)
equals_2 = Equality(FirstNumber=len_2, SecondNumber=0)  # -> Equality, Inequality
dispatch_2 = Dispatch(List=python.udp_out, DispatchPattern=equals_2.Inequality)  # -> ListA, ListB
rec_2 = DataRecorder(dispatch_2.ListA, DataLimit=-10, RecordData=True)
panel_2 = Panel(rec_2)

udp_sender = UDPSender(Data=python.udp_out, IPAddressOfUDPServer="127.0.0.1", UDPPort="5004")
rec_3 = DataRecorder(python.out, DataLimit=-10, RecordData=True)
panel_3 = Panel(rec_3)
